# Grasshopper definition SO- Robot.gh (Grasshopper 0.9.76)
# plug-ins: KUKA|prc - parametric robot control

number_of_rows = Slider(13, range=0..60)
gap = Slider(1.751, range=0..4)
number_slider = Slider(25.4, range=0..100)
brick_height = Number(1.5)
brick_length = Number(8)
brick_width = Number(3.5)
upper_curve = Curve(<curve referenced from the Rhino model>)
lower_curve = Curve(<curve referenced from the Rhino model>)
multiplication = Multiplication(A=brick_length, B=number_slider)
multiplication_2 = Multiplication(A=brick_width, B=number_slider)
multiplication_3 = Multiplication(A=gap, B=number_slider)
multiplication_4 = Multiplication(A=brick_height, B=number_slider)
multiplication_5 = Multiplication(A=multiplication_4, B=number_of_rows)
Z = UnitZ(Factor=multiplication_5)
addition = Addition(A=multiplication, B=multiplication_3)
move = Move(Geometry=upper_curve, Motion=Z)  # -> Geometry, Transform
series = Series(Start=0, Step=multiplication_4, Count=number_of_rows)
num = Number(multiplication_4)
num_2 = Number(multiplication)
num_3 = Number(multiplication_2)
loft = Loft(
    Curves=[move.Geometry, lower_curve],
    Options={Adjust=False, Closed=False, LoftEnds=0, LoftSimp=0, LoftType=0, Rebuild=10, Refit=0.01})
Z_2 = UnitZ(Factor=series)
sec = BrepPlane(Brep=loft, Plane=Z_2)  # -> flatten(Curves), Points
division = Division(A=addition, B=Slider(2, range=0..10))
dispatch = Dispatch(List=sec.Curves, DispatchPattern=[True, False])  # -> ListA, ListB
divdist = DivideDistance(Curve=dispatch.ListB, Distance=division)  # -> Points, Tangents, Parameters
divdist_2 = DivideDistance(Curve=dispatch.ListA, Distance=addition)  # -> Points, Tangents, Parameters
Z_3 = UnitZ(Factor=1)
dispatch_2 = Dispatch(List=divdist.Points, DispatchPattern=[True, False])  # -> ListA, ListB
dispatch_3 = Dispatch(List=divdist.Tangents, DispatchPattern=[True, False])  # -> ListA, ListB
rad = Radians(Degrees=Slider(14, range=0..100))
xy = XYPlane(Origin=divdist_2.Points)
vrot = Rotate(Vector=divdist_2.Tangents, Axis=Z_3, Angle=rad)
vrot_2 = Rotate(Vector=dispatch_3.ListB, Axis=Z_3, Angle=rad)
xy_2 = XYPlane(Origin=dispatch_2.ListB)
pl = PlaneNormal(Origin=divdist_2.Points, ZAxis=vrot)
pl_2 = PlaneNormal(Origin=dispatch_2.ListB, ZAxis=vrot_2)
rad_2 = Radians(Degrees=Slider(20, range=0..100))
align = AlignPlane(Plane=xy_2, Direction=vrot_2)  # -> Plane, Angle
box = CenterBox(Base=[pl, pl_2], X=expr("x/2", num_2), Y=expr("x/2", num), Z=expr("x/2", num_3))
align_2 = AlignPlane(Plane=xy, Direction=vrot)  # -> Plane, Angle
weave = Weave(Pattern=[0, 1], Stream0=align_2.Plane, Stream1=align.Plane, NullGaps=False)  # -> flatten(Weave)
Z_4 = UnitZ(Factor=Slider(254, range=0..1000))
kuka_kr30_60 = KUKAKR3060HA(highresactive=False, infiniterot=False)

rev = ReverseList(List=weave)
move_2 = Move(Geometry=weave, Motion=Z_4)  # -> flatten(Geometry), Transform
_8 = Number(8)
_9 = Number(9)
_9_2 = Number(9)
_8_2 = Number(8)
_3 = Number(3)
gipper_close = CripperClose(io_number=_8_2, io_state=Toggle(False))
gripper_open = CripperClose(io_number=_9, io_state=Toggle(True))
cripper_close = CripperClose(io_number=_8, io_state=Toggle(True))
gripper_open_2 = CripperClose(io_number=_9_2, io_state=Toggle(False))
_10_above_planes = KUKAPrcLINearMovement(TargetAsPlane=move_2.Geometry, extaxenabled=False, impedancemode=False, interpolation="C_DIS")
at_brick_location = KUKAPrcLINearMovement(TargetAsPlane=weave, extaxenabled=False, impedancemode=False, interpolation="C_DIS")
conveyor = KUKAPrcAXISMovement(
    Axis1=Slider(-35.98, range=-100..100),
    Axis2=Slider(-50.97, range=-100..100),
    Axis3=Slider(88.76, range=-100..100),
    Axis4=Slider(4.25, range=-100..100),
    Axis5=Slider(47.27, range=-100..100),
    Axis6=Slider(-152.5, range=-300..300),
    extaxenabled=False,
    impedancemode=False,
    interpolation="C_PTP")
_10_above_conveyor = KUKAPrcAXISMovement(
    Axis1=Slider(-35.98, range=-100..100),
    Axis2=Slider(-56.33, range=-100..100),
    Axis3=Slider(82.24, range=-100..100),
    Axis4=Slider(3.8, range=-100..100),
    Axis5=Slider(59.15, range=-100..100),
    Axis6=Slider(-151.51, range=-300..300),
    extaxenabled=False,
    impedancemode=False,
    interpolation="C_PTP")
wait = KUKAPrcWait(KUKAPrcWait=_3)
number_slider_2 = Slider(59, range=0..100)
lng = ListLength(List=weave)
dup = DuplicateData(Data=gipper_close, Number=lng, Order=True)
dup_2 = DuplicateData(Data=gripper_open, Number=lng, Order=True)
dup_3 = DuplicateData(Data=conveyor, Number=lng, Order=True)
dup_4 = DuplicateData(Data=_10_above_conveyor, Number=lng, Order=True)
dup_5 = DuplicateData(Data=wait, Number=lng, Order=True)
dup_6 = DuplicateData(Data=cripper_close, Number=lng, Order=True)
dup_7 = DuplicateData(Data=gripper_open_2, Number=lng, Order=True)
schunk_pgn160 = SchunkPGN160Gripper(ToolNumber=Slider(2, range=0..10), ToolState=False)
cmd_weave = CommandWeaver(
    Command1=dup,
    Command2=dup_2,
    Command3=dup_4,
    Command4=dup_3,
    Command5=dup_6,
    Command6=dup_7,
    Command7=dup_5,
    Command8=dup_4,
    Command9=_10_above_planes,
    Command10=at_brick_location,
    Command11=dup,
    Command12=dup_2,
    Command13=dup_5,
    Command14=_10_above_planes,
    enabletree=False)
kuka_prc = KUKAPrcCORE(
    SimulationSlider=Slider(1, range=0..1),
    KUKAPrcCommands=cmd_weave,
    KUKAPrcTool=schunk_pgn160,
    KUKAPrcRobot=kuka_kr30_60,
    acc_cp=nan,
    acc_ptp=-1,
    basea=0,
    baseb=0,
    basec=0,
    baseindex=0,
    basex=0,
    basey=0,
    basez=0,
    camrobformatting="""&ACCESS RVP
&REL 1
&PARAM TEMPLATE = C:\KRC\Roboter\Template\vorgabe
&PARAM EDITMASK = *
[PROJECTNAME]

[SPLITDEFS]

;FOLD INI
;FOLD BASISTECH INI
GLOBAL INTERRUPT DECL 3 WHEN $STOPMESS==TRUE DO IR_STOPM ( )
INTERRUPT ON 3
BAS (#INITMOV,0 )
;ENDFOLD (BASISTECH INI)
;ENDFOLD (INI)

[STARTAXPOS]

[SETPARAMETERS]

[COMMANDS]

END""",
    camrobon=False,
    checkallcolls=False,
    enda01=5,
    enda02=-90,
    enda03=100,
    enda04=5,
    enda05=10,
    enda06=-5,
    ende01=0,
    ende02=0,
    ende03=0,
    ende04=0,
    endindex=0,
    haltatend=False,
    hardcode=False,
    hash=31956,
    initialstatus="110",
    int_advance=3,
    int_cdis=nan,
    int_cori=nan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)  # -> RobotGeometry, AnalysisOutput

# ==== cluster CripperClose
io_state = ClusterInput()
io_number = ClusterInput()
int = Integer(io_number)
bool = Boolean(io_state)
concat = Concatenate(FragmentA="$OUT[", FragmentB=int)
concat_2 = Concatenate(FragmentA=concat, FragmentB="]=")
concat_3 = Concatenate(FragmentA=concat_2, FragmentB=bool)
custom_krl = KUKAPrcCustomKRL(TextAsKRL=concat_3)
command = ClusterOutput(custom_krl)
