# Grasshopper definition SO.gh (Grasshopper 0.9.80)
# plug-ins: Python Interpreter

# ---- group: imputs
number_of_rows = Slider(3, range=0..60)
gap = Slider(1.466, range=0..4)
brick_length = Number(7.625)
brick_width = Number(3.325)
lower_curve = Curve(<curve referenced from the Rhino model>)
upper_curve = Curve(<curve referenced from the Rhino model>)
brick_height = Number(2.25)

# ---- group: move upper curve up
multiplication = Multiplication(A=brick_height, B=number_of_rows)
Z = UnitZ(Factor=multiplication)
move = Move(Geometry=upper_curve, Motion=Z)  # -> Geometry, Transform

# ---- group: create planes to divide rows of bricks
series = Series(Start=0, Step=brick_height, Count=number_of_rows)
Z_2 = UnitZ(Factor=series)

# ---- group: distance from one brick to the next
addition = Addition(A=brick_length, B=gap)

# ---- group: brick dimensions
num = Number(brick_height)
num_2 = Number(brick_width)
num_3 = Number(brick_length)

# ---- group: create wall surface
loft = Loft(
    Curves=[move.Geometry, lower_curve],
    Options={Adjust=False, Closed=False, LoftEnds=0, LoftSimp=0, LoftType=0, Rebuild=10, Refit=0.01})

# ---- group: find intersection of surface and planes
sec = BrepPlane(Brep=loft, Plane=Z_2)  # -> flatten(Curves), Points

# ---- group: split intersections into even and odd rows
dispatch = Dispatch(List=sec.Curves, DispatchPattern=[True, False])  # -> ListA, ListB

# ---- group: on odd rows split by half length between bricks, and keep everyother
division = Division(A=addition, B=Slider(2, range=0..10))
divdist = DivideDistance(Curve=dispatch.ListB, Distance=division)  # -> Points, Tangents, Parameters
dispatch_2 = Dispatch(List=divdist.Tangents, DispatchPattern=[True, False])  # -> ListA, ListB
dispatch_3 = Dispatch(List=divdist.Points, DispatchPattern=[True, False])  # -> ListA, ListB

# ----
python = PythonScript()  # -> out, a
# ---------- python: Python ----------
__author__ = "rachellutes"

import rhinoscriptsyntax as rs

height = 2.25
length = 7.625
width = 3.325
gap = .9
rowCount = 10
upperCurve = rs.GetCurveObject()
lowerCurve = rs.GetCurveObject()

upperCurve = rs.MoveObject(upperCurve, (rs.VectorCreate([0,0,0],[0,1,0])))
loftedSurface = rs.AddLoftSrf(upperCurve,lowerCurve)
# ---------- end python ----------

# ---- group: on even rows split by legth between bricks
divdist_2 = DivideDistance(Curve=dispatch.ListA, Distance=addition)  # -> Points, Tangents, Parameters

# ----
tangent_vectors = Geometry([divdist_2.Tangents, dispatch_2.ListB])
points = Geometry([dispatch_3.ListB, divdist_2.Points])

# ---- group: rotation
Z_3 = UnitZ(Factor=1)
rad = Radians(Degrees=Slider(92, range=0..100))
vrot = Rotate(Vector=divdist_2.Tangents, Axis=Z_3, Angle=rad)
vrot_2 = Rotate(Vector=dispatch_2.ListB, Axis=Z_3, Angle=rad)

# ----
xy = XYPlane(Origin=dispatch_3.ListB)
xy_2 = XYPlane(Origin=dispatch_3.ListB)
xy_3 = XYPlane(Origin=divdist_2.Points)
pl = PlaneNormal(Origin=divdist_2.Points, ZAxis=vrot)  # -> flatten(Plane)
pl_2 = PlaneNormal(Origin=dispatch_3.ListB, ZAxis=vrot_2)
align = AlignPlane(Plane=xy_2, Direction=vrot_2)  # -> Plane, Angle
align_2 = AlignPlane(Plane=xy_3, Direction=vrot)  # -> Plane, Angle
box = CenterBox(Base=[pl, pl_2], X=expr("x/2", num_3), Y=expr("x/2", num), Z=expr("x/2", num_2))
panel = Panel(align_2.Plane)
panel_2 = Panel(align.Plane)
weave = Weave(Pattern=[0, 1], Stream0=align_2.Plane, Stream1=align.Plane, NullGaps=False)  # -> flatten(Weave)
panel_3 = Panel(weave)
Z_4 = UnitZ(Factor=Slider(254, range=0..1000))
move_2 = Move(Geometry=weave, Motion=Z_4)  # -> Geometry, Transform
number_slider = Slider(-35.98, range=-100..100)
number_slider_2 = Slider(-56.33, range=-100..100)
number_slider_3 = Slider(82.24, range=-100..100)
number_slider_4 = Slider(3.8, range=-100..100)
number_slider_5 = Slider(59.15, range=-100..100)
number_slider_6 = Slider(-151.51, range=-300..300)
number_slider_7 = Slider(-35.98, range=-100..100)
number_slider_8 = Slider(-50.97, range=-100..100)
number_slider_9 = Slider(88.76, range=-100..100)
number_slider_10 = Slider(4.25, range=-100..100)
number_slider_11 = Slider(47.27, range=-100..100)
number_slider_12 = Slider(-152.5, range=-300..300)
number_slider_13 = Slider(3, range=0..10)
number_slider_14 = Slider(3, range=0..10)
# move back up linear
close_gripper = OpenGripper(io_number=Slider(8, range=0..10), io_state=Toggle(True))
close_gripper_2 = OpenGripper(io_number=Slider(8, range=0..10), io_state=Toggle(False))
open_gripper = OpenGripper(io_number=Slider(9, range=0..10), io_state=Toggle(False))
open_gripper_2 = OpenGripper(io_number=Slider(9, range=0..10), io_state=Toggle(True))
panel_4 = Panel("close gripper false")
lng = ListLength()
dup = DuplicateData(Number=lng, Order=True)
dup_2 = DuplicateData(Data=open_gripper, Number=lng, Order=True)
dup_3 = DuplicateData(Data=close_gripper_2, Number=lng, Order=True)
dup_4 = DuplicateData(Number=lng, Order=True)
dup_5 = DuplicateData(Number=lng, Order=True)
dup_6 = DuplicateData(Data=close_gripper, Number=lng, Order=True)
dup_7 = DuplicateData(Number=lng, Order=True)
dup_8 = DuplicateData(Data=open_gripper_2, Number=lng, Order=True)
number_slider_15 = Slider(0, range=0..1)

# ==== cluster OpenGripper
io_state = ClusterInput()
io_number = ClusterInput()
int = Integer(io_number)
concat = Concatenate(FragmentA="$OUT[", FragmentB=int)
bool = Boolean(io_state)
concat_2 = Concatenate(FragmentA=concat, FragmentB="]=")
concat_3 = Concatenate(FragmentA=concat_2, FragmentB=bool)
unresolved_proxy = ClusterOutput(<missing>)
