# Grasshopper definition brick_Fields.gh (Grasshopper 0.9.80)
# plug-ins: Python Interpreter

# ---- group: read data file and limit to results in the state specified, create points.
datafilepath = FilePath("/Users/rachellutes/Documents/UNCC/Fall_2018/ARCH 7210 Ideas Seminar/ideas_seminar_GIT/brickstacking/brickstacking final/data.json")
get_points = PythonScript(limitToResultsContaining="NC", filePath=datafilepath)  # -> out, points
# ---------- get_points: Python ----------
__author__ = "rachellutes"

import rhinoscriptsyntax as rs

fhand = open(filePath)
xCoords = []
yCoords = []
points = []
contain = '"state":"' + limitToResultsContaining

for line in fhand:
	if contain in line:
		line.strip()
		pos = line.find('latitude')
		pos2 = line.find(',',pos)
		pos3 = line.find('longitude')
		pos4 = line.find(',',pos3)
		xCoords.append(float(line[pos+10:pos2]))
		yCoords.append(float(line[pos3+11:pos4]))
		#pos5 = (line.find(':'))
		#id.append(line[pos5+2:pos5+24])

for i in range(len(xCoords)):
	points.append(rs.AddPoint(xCoords[i],yCoords[i],0))
# ---------- end get_points ----------

# ---- group: move points to origin
pdecon = Deconstruct(Point=get_points.points)  # -> XComponent, YComponent, ZComponent
bnd = Bounds(Numbers=pdecon.XComponent)
bnd_2 = Bounds(Numbers=pdecon.YComponent)
dedomain = DeconstructDomain(Domain=bnd)  # -> Start, End
dedomain_2 = DeconstructDomain(Domain=bnd_2)  # -> Start, End
pt = ConstructPoint(XCoordinate=dedomain.Start, YCoordinate=dedomain_2.Start, ZCoordinate=0)
vec2pt = Vector2Pt(PointA=pt, PointB=Point(0, 0, 0), Unitize=False)  # -> Vector, Length
move = Move(Geometry=get_points.points, Motion=vec2pt.Vector)  # -> Geometry, Transform

# ---- group: inputs
brick_width = Slider(7.625, range=0..10)
brick_length = Slider(3.325, range=0..10)
brick_height = Slider(2.25, range=0..10)
scale_the_bricks = Slider(100, range=0..200)
points = Point(move.Geometry)
length = Division(A=brick_length, B=scale_the_bricks)
height = Division(A=brick_height, B=scale_the_bricks)
width = Division(A=brick_width, B=scale_the_bricks)

# ---- group: make a grid of rectangles for the bricks, just large enough to contain all the points
bbox = BoundingBox(Content=points, Plane=PlaneXY(0, 0, 0), UnionBox=True)  # -> Box, Box_2
debox = DeconstructBox(Box=bbox.Box)  # -> Plane, X, Y, Z
pt_2 = ConstructPoint(XCoordinate=debox.X, YCoordinate=debox.Y, ZCoordinate=0)
pdecon_2 = Deconstruct(Point=pt_2)  # -> XComponent, YComponent, ZComponent
division = Division(A=pdecon_2.XComponent, B=width)
division_2 = Division(A=pdecon_2.YComponent, B=length)
round = Round(Number=division)  # -> Nearest, Floor, Ceiling
round_2 = Round(Number=division_2)  # -> Nearest, Floor, Ceiling
grid_for_bricks = Rectangular(Plane=PlaneXY(0, 0, 0), SizeX=width, SizeY=length, ExtentX=round.Ceiling, ExtentY=round_2.Ceiling)  # -> flatten(Cells), flatten(Points)

# ---- group: count number of points in each brick
box_corners = BoxCorners(Box=grid_for_bricks.Cells)  # -> CornerA, CornerB, CornerC, CornerD, CornerE, CornerF, CornerG, CornerH
list_length = ListLength(List=grid_for_bricks.Cells)
list_length_2 = ListLength(List=points)
python = PythonScript(
    grid=grid_for_bricks.Cells,
    point1=box_corners.CornerA,
    point2=box_corners.CornerC,
    points=points,
    gridCount=list_length,
    pointCount=list_length_2)  # -> out, countOfPointsPerGrid; inputs grid: list of Curve, point1: list of Point3d, point2: list of Point3d, points: list of Point3d
# ---------- python: Python ----------
__author__ = "rachellutes"

import rhinoscriptsyntax as rs

countOfPointsPerGrid = [0]* gridCount
index = 0

for rec in range(gridCount):
	pt1 = rs.coerce3dpoint(point1[rec])
	pt2 = rs.coerce3dpoint(point2[rec])
	for p in range(pointCount):
		Point = rs.coerce3dpoint(points[p])
		if (pt1.X <= Point.X <= pt2.X):
			if(pt1.Y <= Point.Y <= pt2.Y):
				countOfPointsPerGrid[rec] = countOfPointsPerGrid[rec]+1




	'''pt1 = rs.coerce3dpoint(gridPoints[index])
	pt2 = rs.coerce3dpoint(gridPoints[index+indexadd])
	index = index + 1'''
# ---------- end python ----------

# ---- group: create brick geometry
bricks = BoxRectangle(Rectangle=grid_for_bricks.Cells, Height=height)  # -> graft(Box)

# ---- group: Base grid
basegrid = Rectangle(grid_for_bricks.Cells)

# ---- group: stack correct number of bricks
series = Series(Start=0, Step=height, Count=python.countOfPointsPerGrid)  # -> simplify(Series)
Z = UnitZ(Factor=series)
bricks_2 = Move(Geometry=bricks, Motion=Z)  # -> Geometry, Transform
