# Grasshopper definition turtle.gh (Grasshopper 0.9.80)

pln = Plane(PlaneXY(2.771876101, 4.84229838, 0))
srf = Surface(<surface referenced from the Rhino model>)
number_slider = Slider(0.3, range=0..1)
ellipse = Ellipse(Plane=pln, Radius1=Slider(5, range=0..10), Radius2=Slider(6, range=0..10))  # -> Ellipse, Focus1, Focus2
pop2d = Populate2D(Region=srf, Count=Slider(160, range=0..200), Seed=1)
crv_cp = CurveClosestPoint(Point=pop2d, Curve=ellipse.Ellipse)  # -> Point, Parameter, Distance
srf_2 = Surface(<surface referenced from the Rhino model>)
division = Division(A=crv_cp.Distance, B=number_slider)
vec2pt = Vector2Pt(PointA=pop2d, PointB=crv_cp.Point, Unitize=False)  # -> Vector, Length
multiplication = Multiplication(A=crv_cp.Distance, B=number_slider)
amp = Amplitude(Vector=vec2pt.Vector, Amplitude=multiplication)
bbox = BoundingBox(Content=srf_2, Plane=PlaneXY(0, 0, 0), UnionBox=True)  # -> Box, Box_2
move = Move(Geometry=pop2d, Motion=amp)  # -> Geometry, Transform
pt = Point([move.Geometry, pop2d])
voronoi = Voronoi(Points=pt, Boundary=srf, BruteForceOverride=False)
dedom2 = DeconstructDomain²(Domain=srf_2)  # -> UComponent, VComponent
boundary = BoundarySurfaces(Edges=voronoi)
srfmorph = SurfaceMorph(
    Geometry=boundary,
    Reference=bbox.Box,
    Surface=srf_2,
    UDomain=dedom2.UComponent,
    VDomain=dedom2.VComponent,
    WDomain=Slider(1, range=0..10))
